# Grasshopper definition klemens_torggler_door.gh (Grasshopper 1.0.7)
# plug-ins: Human

number_slider = Slider(0.0001, range=0.0001..0.9999)
ghpython_script = GhPythonScript(m=number_slider)  # -> out, klemens_torggler_door
# ---------- ghpython_script: Python ----------
import math
import Rhino.Geometry as rg
import ghpythonlib.components as gh

class KlemensTorgglerDoor:
    def __init__(self, door_size=20, handler_param=0.2):
        self.door_size = door_size
        self.handler_param = handler_param
        self._generate()
        
    def _generate(self):
        self._gen_vertices_and_anchor()
        upper_door = self._get_torggler_door(
            self.upper_anchor_plane, self.upper_vertices
        )
        
        lower_door = self._get_torggler_door(
            self.lower_anchor_plane, self.lower_vertices
        )
        
        self.klemenstorgglerdoor = upper_door + lower_door
    
    def _gen_vertices_and_anchor(self):
        self.upper_vertices = [
            rg.Point3d(0, 0, self.door_size),
            rg.Point3d(0, self.door_size / 2, self.door_size),
            rg.Point3d(0, self.door_size / 2, self.door_size / 2),
        ]
        
        self.upper_anchor_plane = self._get_anchor_plane(self.upper_vertices[1])
        
        self.lower_vertices = [
            rg.Point3d(0, 0, 0),
            rg.Point3d(0, self.door_size / 2, 0),
            rg.Point3d(0, self.door_size / 2, self.door_size / 2),
        ]
        
        self.lower_anchor_plane = self._get_anchor_plane(
            self.lower_vertices[1], is_flip=True
        )
        
    def _get_torggler_door(self, anchor_plane, vertices):
        handler_position_y = self.handler_param * self.door_size / 2 * 2
        
        moved_vertices, _ = gh.Rotate(vertices, math.pi * m / 2, anchor_plane)
        p3 = moved_vertices[0] / 2 + moved_vertices[2] / 2
        p4 = rg.Point3d(0, handler_position_y, self.door_size / 2)
        b = p3.DistanceTo(p4)
        
        handler_position_x = (
            0 
            if handler_position_y in (0, self.door_size / 2 * 2) 
            else math.sqrt(self.door_size ** 2 / 8 - b ** 2)
        )
        
        handle = rg.Point3d(
            handler_position_x, handler_position_y, self.door_size / 2
        )
    
        door_each_part = [
            rg.PolylineCurve(moved_vertices + moved_vertices[:1]),
            rg.PolylineCurve(
                [
                    moved_vertices[0], 
                    moved_vertices[2], 
                    handle, 
                    moved_vertices[0]
                ]
            )
        ]
        
        return door_each_part
        
    def _get_anchor_plane(self, vertex, is_flip=False):
        return gh.FlipPlane(
            plane=gh.YZPlane(vertex),
            reverse_x=False,
            reverse_y=False,
            swap_axes=is_flip
            
        )

if __name__ == "__main__":
    ktd = KlemensTorgglerDoor(door_size=20, handler_param=m)
    klemens_torggler_door = ktd.klemenstorgglerdoor
# ---------- end ghpython_script ----------

# ---- group: regulation segments
boundary_surfaces = BoundarySurfaces(Edges=ghpython_script.klemens_torggler_door)
explode = Explode(Curve=ghpython_script.klemens_torggler_door, Recursive=True)  # -> flatten(Segments), flatten(Vertices)
custom_preview = CustomPreview(Geometry=boundary_surfaces, Material=ColourSwatch(SwatchColor=RGB(0, 0, 0)))
line_sdl = LineSDL(Start="0,0,10", Direction="0,1,0", Length=20)
list_item = ListItem(List=explode.Segments, Index=[2, 8], Wrap=True)
list_item_2 = ListItem(List=explode.Vertices, Index=6, Wrap=True)
explode_2 = Explode(Curve=line_sdl, Recursive=True)  # -> flatten(Segments), flatten(Vertices)
evaluate_curve = EvaluateCurve(Curve=reparameterize(line_sdl), Parameter=number_slider)  # -> Point, Tangent, Angle
curve_middle = CurveMiddle(Curve=list_item)
list_item_3 = ListItem(List=curve_middle, Index=0, Wrap=True)
list_item_4 = ListItem(List=curve_middle, Index=1, Wrap=True)
point = Point(explode_2.Vertices)
merge = Merge(Data1=evaluate_curve.Point, Data2=list_item_2, Data3=list_item_3)
merge_2 = Merge(Data1=evaluate_curve.Point, Data2=list_item_2, Data3=list_item_4)
line = Line(StartPoint=evaluate_curve.Point, EndPoint=list_item_2)
polyline = PolyLine(Vertices=merge, Closed=True)
polyline_2 = PolyLine(Vertices=merge_2, Closed=True)
list_item_5 = ListItem(List=point, Index=1, Wrap=True)
list_item_6 = ListItem(List=point, Index=0, Wrap=True)
arc_3pt = Arc3Pt(PointA=list_item_5, PointB=list_item_2, PointC=list_item_6)  # -> Arc, Plane, Radius
dash_pattern = DashPattern(Curve=[polyline, polyline_2, line_sdl], Pattern=0.3)  # -> Dashes, Gaps
custom_preview_2 = CustomPreview(Geometry=point, Material=ColourSwatch(SwatchColor=RGB(92, 92, 92)))
colour_swatch = ColourSwatch(SwatchColor=RGB(34, 0, 255))
dash_pattern_2 = DashPattern(Curve=[arc_3pt.Arc, line], Pattern=0.3)  # -> Dashes, Gaps
custom_preview_lineweights = CustomPreviewLineweights(Geometry=dash_pattern_2.Dashes, Shader=colour_swatch, Thickness=3, Absolute=False)
custom_preview_3 = CustomPreview(Geometry=dash_pattern.Dashes, Material=colour_swatch)

# ----
custom_preview_4 = CustomPreview(Geometry=[explode.Vertices, point, list_item_3, list_item_4, list_item_2], Material=colour_swatch)
colour_swatch_2 = ColourSwatch(SwatchColor=RGB(0, 0, 0))
colour_swatch_3 = ColourSwatch(SwatchColor=RGB(255, 0, 0))
custom_preview_5 = CustomPreview(Geometry=explode.Segments, Material=ColourSwatch(SwatchColor=RGB(176, 176, 176)))
text_tag_3d = TextTag3D(Location=list_item_2, Text="handle", Size=1, Colour=colour_swatch_3, Justification=4)
text_tag_3d_2 = TextTag3D(Location=curve_middle, Text="piano hinge", Size=0.8, Colour=colour_swatch_3, Justification=4)
